# Grasshopper definition convert_building_physics.gh (Grasshopper 0.9.76)
# plug-ins: Python Interpreter, FalseStartToggle

# ---- group: sets time steps for simulation
# Simulation Data
start_month = Panel("1")
start_day = Panel("1")
# Export Attributes and Results
number_of_hours = Panel("127")
doy_hoy = Ladybug_DOY_HOY(days=start_day, months=start_month, hours=1)  # -> HOY, DOY, date; plug-in component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
open_weather_file = Ladybug_OpenEPWWeatherFile(open=Toggle(True))  # -> epwFile; plug-in component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
series = Series(Start=0, Step=1, Count=number_of_hours)
addition = Addition(A=doy_hoy.HOY, B=series)
int = Integer(addition)
python = PythonScript()  # -> out, location, temperature, Irradiation
# ---------- python: Python ----------
pass
# ---------- end python ----------
importepw = Ladybug_ImportEpw(epwFile=open_weather_file)  # -> readMe, latitude, location, dryBulbTemperature, dewPointTemperature, relativeHumidity, windSpeed, windDirection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; plug-in component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
strnum = Ladybug_SeparateData(inputList=flatten(importepw.dryBulbTemperature))  # -> numbers, strings; plug-in component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
strnum_2 = Ladybug_SeparateData(inputList=flatten(importepw.directNormalRadiation))  # -> numbers, strings; plug-in component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
strnum_3 = Ladybug_SeparateData(inputList=flatten(importepw.diffuseHorizontalRadiation))  # -> numbers, strings; plug-in component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
item = ListItem(List=strnum.numbers, Index=int, Wrap=True)  # -> simplify(Item)
item_2 = ListItem(List=strnum_2.numbers, Index=int, Wrap=True)  # -> simplify(Item)
item_3 = ListItem(List=strnum_3.numbers, Index=int, Wrap=True)  # -> simplify(Item)
energy = QuickGraph([item_2, item_3])

# ----
# Draw a room with windows
panel = Panel("4.9")
ladybug = Ladybug_Ladybug()  # -> Vviiiiiiiiiizzz; plug-in component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
# Get temperatures and calculate radiation using ladybug
outward_facing_surfaces = Panel("0")
box = DomainBox(Base=PlaneXY(0, 0, 0), X=panel, Y="7", Z="3.1")

# ----
# RC building simulation
emissionsystems = EmissionSystems()  # -> out; plug-in component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
supplysystems = SupplySystems()  # -> out; plug-in component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
modularbuildingphysics = ModularBuildingPhysics()  # -> out; plug-in component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

debrep = DeconstructBrep(Brep=box)  # -> Faces, Edges, Vertices
item_4 = ListItem(List=debrep.Faces, Index=outward_facing_surfaces, Wrap=True)

# ---- group: display
cull_i = CullIndex(List=debrep.Faces, Indices=outward_facing_surfaces, Wrap=True)
cluster = Cluster(G=debrep.Faces, L=debrep.Faces)  # -> orientedtocam, int_2
tag = TextTag3D(Location=cluster.orientedtocam, Text=cluster.int_2, Size=0.4, Justification=7)

# ----
window_wall_ratio = Slider(0.9, range=0..1)
edges = BrepEdges(Brep=item_4)  # -> simplify(Naked), Interior, NonManifold
join = JoinCurves(Curves=edges.Naked, Preserve=False)
edges_2 = BrepEdges(Brep=cull_i)  # -> Naked, Interior, NonManifold
area = Area(Geometry=join)  # -> simplify(Area), Centroid
scale = Scale(Geometry=join, Center=area.Centroid, Factor=window_wall_ratio)  # -> flatten(Geometry), Transform
srfsplit = SurfaceSplit(Surface=item_4, Curves=scale.Geometry)
item_5 = ListItem(List=debrep.Faces, Index=4, Wrap=True)
walls = ListItem(List=srfsplit, Index=0, Wrap=True)  # -> flatten(Item)
walls_2 = ListItem(List=srfsplit, Index=1, Wrap=True)  # -> flatten(Item)

# ---- group: Solar Gains
run_radiation = FalseStartToggle(False)  # disabled
hour_to_simulate = Slider(0, range=0..127)  # disabled
panel_2 = Panel("hour_to_simulate")  # disabled
c_script = CSharpScript(name=panel_2, min=0, max=number_of_hours, decimals=0)  # -> out, A; inputs name: String, min: Double, max: Double, decimals: Int32; disabled
# ---------- c_script: C# ----------
    foreach (IGH_DocumentObject obj in owner.OnPingDocument().Objects )
    {
      Grasshopper.Kernel.Special.GH_NumberSlider slider = obj as Grasshopper.Kernel.Special.GH_NumberSlider;
      if (slider == null) { continue; }
      if (slider.NickName.Equals(name, StringComparison.OrdinalIgnoreCase))
      {
        double norm = slider.Slider.NormalizedValue;

        slider.Slider.Minimum = (decimal) min;
        slider.Slider.Maximum = (decimal) max;
        if (decimals <= 0)
        {
          slider.Slider.Type = Grasshopper.GUI.Base.GH_SliderAccuracy.Integer;
        }
        else
        {
          slider.Slider.Type = Grasshopper.GUI.Base.GH_SliderAccuracy.Float;
          slider.Slider.DecimalPlaces = decimals;
        }

        //Must disable events since we are modifying this thing during a solution.
        //This is actually illegal.
        slider.Slider.RaiseEvents = false;
        slider.Slider.NormalizedValue = norm;
        slider.Slider.RaiseEvents = true;
      }
    }
# ---------- c_script: C# additional code ----------
///Taken from: http://www.grasshopper3d.com/forum/topics/change-number-slider-parameter-using-python
# ---------- end c_script ----------
toggle = BooleanToggle(True)  # disabled
gencumulativeskymtx = Ladybug_GenCumulativeSkyMtx(epwFile=open_weather_file, skyDensity=0, useOldRes=True, runIt=toggle)  # -> readMe, cumulativeSkyMtx; disabled; plug-in component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
fly = Ladybug_fly(inputSliders=hour_to_simulate, fly=run_radiation)  # -> Vviiiiiiiiiizzz; disabled; plug-in component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
item_6 = ListItem(List=int, Index=hour_to_simulate, Wrap=True)  # disabled
selectskymtx = Ladybug_selectSkyMtx(cumulativeSkyMtx=gencumulativeskymtx.cumulativeSkyMtx, HOY=item_6, removeDiffuse=False, removeDirect=False)  # -> readMe, selectedSkyMtx; disabled; plug-in component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
toggle_2 = BooleanToggle(True)  # disabled
panel_3 = Panel("1")  # disabled
panel_4 = Panel(".1")  # disabled
radiationanalysis = Ladybug_RadiationAnalysis(
    geometry=flatten(walls_2),
    gridSize=panel_3,
    disFromBase=panel_4,
    selectedSkyMtx=flatten(selectskymtx.selectedSkyMtx),
    runIt=toggle_2)  # -> readMe, contextMesh, analysisMesh, testPts, testVec, port, radiationResult, radiationMesh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; disabled; plug-in component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
multiplication = Multiplication(A=radiationanalysis.totalRadiation, B=1000)  # disabled
variable_recorder = PythonScript(x=multiplication, array_length=number_of_hours)  # -> out, recorded_result; inputs array_length: Int32; disabled
# ---------- variable_recorder: Python ----------
"""
Data recorder with variable output length.

#TODO: reset recL every time array_length is changed.
"""
if 'recL' in locals() and array_length!=None:
        recL.append(x)
else:
    recL = []

recorded_result = recL[len(recL)-array_length:]
# ---------- end variable_recorder ----------

# ----
volume = Volume(Geometry=box)  # -> Volume, Centroid
area_2 = Area(Geometry=item_5)  # -> Area, Centroid

# ---- group: Hacky grasshopper way to read schedule from csv
# Internal Gains
occupancy_schedules_csv = Panel("C:\Users\Zghiru\Documents\GitHub\RC_BuildingSimulator\rc_simulator\grasshopper_component\occupancy_schedules.csv")
file = ReadFile(File=occupancy_schedules_csv, PerLineParse=True)
list = ValueList({"Multi Residential": 0, "Single Residential": 1, "Hotel": 2, "Office": 3, "Retail": 4, "Foodstore": 5, "Restaurant": 6, "Industrial": 7, "School": 8, "Hospital": 9, "Gym": 10}, selected="Office")
split = TextSplit(Text=file, Separators=",")  # -> simplify(Result)
item_7 = ListItem(List=split, Index=list, Wrap=True)  # -> flatten(Item)
panel_5 = Panel(split)
cull_i_2 = CullIndex(List=item_7, Indices=0, Wrap=True)
item_8 = ListItem(List=cull_i_2, Index=int, Wrap=True)
python_2 = PythonScript(area=area_2.Area, max_occupancy="3", occupancy_per_m2=item_8)  # -> out, occupancy, internal_gains; inputs occupancy_per_m2: list
# ---------- python_2: Python ----------
# This doesn't make sense yet 
#The units for rate should be 
# occupancy = rate * number of occupants * area

gains_per_person = 100 #W
appliance_gains = 14  # W per sqm

occupancy = list(map(lambda x:max_occupancy*x, occupancy_per_m2))

internal_gains = list(map(lambda x: gains_per_person*x + area*appliance_gains, occupancy))
# ---------- end python_2 ----------

# ----
hour_to_visualise = Slider(72, range=1..128)
addition_2 = Addition(A=doy_hoy.HOY, B=number_of_hours)
debrep_2 = DeconstructBrep(Brep=walls_2)  # -> Faces, Edges, Vertices
c_script_2 = CSharpScript(name="hour_to_visualise", min=doy_hoy.HOY, max=addition_2, decimals=0)  # -> out, A; inputs name: String, min: Double, max: Double, decimals: Int32; same code as c_script
series_2 = Series(Start=-1, Step=1, Count=2)
walls_3 = ListItem(List=debrep_2.Edges, Index=2, Wrap=True)  # -> flatten(Item)
Z = UnitZ(Factor=series_2)
selectskymtx_2 = Ladybug_selectSkyMtx(cumulativeSkyMtx=gencumulativeskymtx.cumulativeSkyMtx, removeDiffuse=False, removeDirect=False)  # -> readMe, selectedSkyMtx; disabled; plug-in component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
exportladybug = Ladybug_ExportLadybug()  # -> readMe; plug-in component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
number_slider = Slider(1.3, range=1..2)
panel_6 = Panel("47.377")  # disabled
panel_7 = Panel("8.549")  # disabled
panel_8 = Panel(strnum_2.numbers)  # disabled
# Lighting data
title = Panel("indoor_air_temperature")
title_2 = Panel("outdoor_air_temperature")
title_3 = Panel("occupancy")
title_4 = Panel("ill")
# Energy data
title_5 = Panel("HOY")
title_6 = Panel("solar_gains")
title_7 = Panel("heating_demand")
title_8 = Panel("cooling_demand")
title_9 = Panel("lighting_demand")
# Temperature data
title_10 = Panel("HOY")
title_11 = Panel("internal_gains")
ins = InsertItems(List=int, Item=title_5, Indices=0, Wrap=True)  # -> graft(List)
ins_2 = InsertItems(List=python_2.internal_gains, Item=title_11, Indices=0, Wrap=True)  # -> graft(List)
ins_3 = InsertItems(List=int, Item=title_10, Indices=0, Wrap=True)  # -> graft(List)
ins_4 = InsertItems(List=item, Item=title_2, Indices=0, Wrap=True)  # -> graft(List)
ins_5 = InsertItems(List=int, Item=title_10, Indices=0, Wrap=True)  # -> graft(List)
ins_6 = InsertItems(List=python_2.occupancy, Item=title_3, Indices=0, Wrap=True)  # -> graft(List)

radiation = Panel("hoy")  # disabled
radiation_2 = Panel("radiation")  # disabled
radiation_3 = Panel("internal_gains")  # disabled
day_month_hour_calculator = Ladybug_Day_Month_Hour(HOY=int)  # -> day, month, hour, date; disabled; plug-in component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
ins_7 = InsertItems(List=variable_recorder.recorded_result, Item=radiation_2, Indices=0, Wrap=True)  # -> graft(List); disabled
ins_8 = InsertItems(List=python_2.internal_gains, Item=radiation_3, Indices=0, Wrap=True)  # -> graft(List); disabled
ins_9 = InsertItems(List=day_month_hour_calculator.date, Item=radiation, Indices=0, Wrap=True)  # -> graft(List); disabled
merge = Merge(Data1=simplify(ins_9), Data2=simplify(ins_7), Data3=simplify(ins_8))  # disabled
join_2 = TextJoin(Text=merge, Join=",")  # -> flatten(Result); disabled
inputs = Panel(join_2)  # disabled

panel_9 = Panel("C:\Users\Zghiru\Documents\GitHub\RC_BuildingSimulator\rc_simulator\grasshopper_component\tests\grasshopper_result_energy.csv")  # disabled
panel_10 = Panel("C:\Users\Zghiru\Documents\GitHub\RC_BuildingSimulator\rc_simulator\grasshopper_component\tests\grasshopper_result_temperatures.csv")  # disabled
panel_11 = Panel("C:\Users\Zghiru\Documents\GitHub\RC_BuildingSimulator\rc_simulator\grasshopper_component\tests\grasshopper_result_lighting.csv")  # disabled
toggle_3 = BooleanToggle(False)
panel_12 = Panel("C:\Users\Zghiru\Documents\GitHub\RC_BuildingSimulator\rc_simulator\grasshopper_component\tests\grasshopper_attributes.csv")
panel_13 = Panel("C:\Users\Zghiru\Documents\GitHub\RC_BuildingSimulator\rc_simulator\grasshopper_component\tests\grasshopper_result.csv")
panel_14 = Panel("""Cooling
Heating
Lighting""")
python_3 = PythonScript(fileAddress=panel_12, export=toggle_3)  # -> out, a; inputs results: list
# ---------- python_3: Python ----------
import Rhino as rc

if export:
    fileName = open(fileAddress,'w+')
    for line in results:
        fileName.write(line + '\n')
    fileName.close()
# ---------- end python_3 ----------
Y = UnitY(Factor=Slider(0.4, range=0..3))
extr = Extrude(Base=walls_3, Direction=expr("-x", Y))

# ----
# Create Zone
number_slider_2 = Slider(0.1, range=0..0.6)
opaqueelement = OpaqueElement(geometry=walls, u_value=number_slider_2)  # -> out, centers, normals, opaque_element; plug-in component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
glazedelement = GlazedElement(
    window_geometry=walls_2,
    context_geometry=extr,
    u_value=Slider(1.2, range=1..2),
    location=importepw.location,
    hoy_list=int,
    dni_list=item_2,
    dhi_list=item_3,
    run_solar=Toggle(True),
    hour_to_visualise=hour_to_visualise)  # -> out, glazed_elements, solar_gains, illuminance, shadow; inputs context_geometry: list, hoy_list: list, dni_list: list, dhi_list: list; plug-in component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
zone2 = Zone2(
    glazed_elements=glazedelement.glazed_elements,
    opaque_elements=opaqueelement.opaque_element,
    volume=volume.Volume,
    floor_area=area_2.Area,
    ach_vent=number_slider,
    ach_infl=number_slider)  # -> readMe, Zone, unique_inputs; inputs glazed_elements: list, opaque_elements: list, thermal_bridges: list; plug-in component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

move = Move(Geometry=extr, Motion=Z)  # -> Geometry, Transform
radiationanalysis_2 = Ladybug_RadiationAnalysis(
    geometry=flatten(walls_2),
    context=flatten(extr),
    gridSize=0.3,
    disFromBase=panel_4,
    selectedSkyMtx=flatten(selectskymtx_2.selectedSkyMtx),
    runIt=toggle_2)  # -> readMe, contextMesh, analysisMesh, testPts, testVec, port, radiationResult, radiationMesh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; disabled; plug-in component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

# ---- group: simulate period
# Simulate Period
simulatemultipletimesteps = SimulateMultipleTimeSteps(
    Zone=simplify(zone2.Zone),
    outdoor_air_temperature=simplify(item),
    internal_gains=simplify(python_2.internal_gains),
    solar_gains=simplify(glazedelement.solar_gains),
    occupancy=simplify(python_2.occupancy),
    illuminance=simplify(glazedelement.illuminance))  # -> out, indoor_air_temperature, mass_temperature, lighting_demand, heating_demand, cooling_demand, energy_demand, solar_gains, ill; inputs outdoor_air_temperature: list, previous_mass_temperature: list, internal_gains: list, solar_gains: list, occupancy: list, illuminance: list; plug-in component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
cooling_demand_w = Panel(simulatemultipletimesteps.cooling_demand)
outdoor_temperature = Panel(item)
heating_demand_w = Panel(simulatemultipletimesteps.heating_demand)
indoor_temperature = Panel(simulatemultipletimesteps.indoor_air_temperature)
lighting_demand_w = Panel(simulatemultipletimesteps.lighting_demand)
mass_temperature = Panel(simulatemultipletimesteps.mass_temperature)

# ----
ins_10 = InsertItems(List=simulatemultipletimesteps.cooling_demand, Item=title_8, Indices=0, Wrap=True)  # -> graft(List)
ins_11 = InsertItems(List=simulatemultipletimesteps.heating_demand, Item=title_7, Indices=0, Wrap=True)  # -> graft(List)
ins_12 = InsertItems(List=simulatemultipletimesteps.lighting_demand, Item=title_9, Indices=0, Wrap=True)  # -> graft(List)
ins_13 = InsertItems(List=simulatemultipletimesteps.solar_gains, Item=title_6, Indices=0, Wrap=True)  # -> graft(List)
ins_14 = InsertItems(List=simulatemultipletimesteps.indoor_air_temperature, Item=title, Indices=0, Wrap=True)  # -> graft(List)
ins_15 = InsertItems(List=simulatemultipletimesteps.ill, Item=title_4, Indices=0, Wrap=True)  # -> graft(List)
merge_2 = Merge(
    Data1=simplify(ins),
    Data2=simplify(ins_13),
    Data3=simplify(ins_11),
    Data4=simplify(ins_10),
    Data5=simplify(ins_12),
    Data6=simplify(ins_2))  # disabled
merge_3 = Merge(Data1=simplify(ins_3), Data2=simplify(ins_4), Data3=simplify(ins_14))  # disabled
merge_4 = Merge(Data1=simplify(ins_5), Data2=simplify(ins_15), Data3=simplify(ins_6))  # disabled
join_3 = TextJoin(Text=merge_2, Join=",")  # -> flatten(Result); disabled
join_4 = TextJoin(Text=merge_3, Join=",")  # -> flatten(Result); disabled
join_5 = TextJoin(Text=merge_4, Join=",")  # -> flatten(Result); disabled
python_4 = PythonScript(results=join_3, fileAddress=panel_9, export=toggle_3)  # -> out, a; inputs results: list; disabled
# ---------- python_4: Python ----------
import Rhino as rc

if export:
    fileName = open(fileAddress,'w')
    for line in results:
        fileName.write(line + '\n')
    fileName.close()
# ---------- end python_4 ----------
python_5 = PythonScript(results=join_4, fileAddress=panel_10, export=toggle_3)  # -> out, a; inputs results: list; disabled; same code as python_4
python_6 = PythonScript(results=join_5, fileAddress=panel_11, export=toggle_3)  # -> out, a; inputs results: list; disabled; same code as python_4
merge_5 = Merge(
    Data1=simplify(ins),
    Data2=simplify(ins_13),
    Data3=simplify(ins_11),
    Data4=simplify(ins_10),
    Data5=simplify(ins_12),
    Data6=simplify(ins_2),
    Data7=simplify(ins_3),
    Data8=simplify(ins_4),
    Data9=simplify(ins_14),
    Data10=simplify(ins_5),
    Data11=simplify(ins_15),
    Data12=simplify(ins_6))
ma = MassAddition(Input=flatten(simulatemultipletimesteps.cooling_demand))  # -> Result, PartialResults
multiplication_2 = Multiplication(A=ma.Result, B="-1")
join_6 = TextJoin(Text=merge_5, Join=",")  # -> flatten(Result)
ma_2 = MassAddition(Input=flatten(simulatemultipletimesteps.heating_demand))  # -> Result, PartialResults
python_7 = PythonScript(results=join_6, fileAddress=panel_13, export=toggle_3)  # -> out, a; inputs results: list; same code as python_3
ma_3 = MassAddition(Input=flatten(simulatemultipletimesteps.lighting_demand))  # -> Result, PartialResults
merge_6 = Merge(Data1=multiplication_2, Data2=ma_2.Result, Data3=ma_3.Result)  # -> simplify(graft(Result))
panel_15 = Panel(merge_6)
repeat = RepeatData(Data=graft(panel_14), Length=merge_6)  # -> flatten(Data)
pie = PieChart(repeat)

# ----
# Unit Tests (just like python version)
panel_16 = Panel("test")
buildingphysics = BuildingPhysics()  # -> out; plug-in component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
test = Slider(0, range=0..16)
unit_test_master = UnitTestMaster(run=test)  # -> out, number_of_tests, Zone, port, outdoor_air_temperature, previous_mass_temperature, internal_gains, solar_gains, illuminance, occupancy; inputs run: Int32; plug-in component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
c_script_3 = CSharpScript(name=panel_16, min=0, max=unit_test_master.number_of_tests, decimals=0)  # -> out, A; inputs name: String, min: Double, max: Double, decimals: Int32; same code as c_script
simulateonetimestep = SimulateASingleTimeStep(
    Zone=unit_test_master.Zone,
    outdoor_air_temperature=unit_test_master.outdoor_air_temperature,
    previous_mass_temperature=unit_test_master.previous_mass_temperature,
    internal_gains=unit_test_master.internal_gains,
    solar_gains=unit_test_master.solar_gains,
    illuminance=unit_test_master.illuminance,
    occupancy=unit_test_master.occupancy)  # -> readMe, indoor_air_temperature, mass_temperature, lighting_demand, heating_demand, heating_sys_electricity, cooling_demand, cooling_sys_electricity, energy_demand, cop; plug-in component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
unit_test_slave = UnitTestSlave(
    mass_temperature=simulateonetimestep.mass_temperature,
    lighting_demand=simulateonetimestep.lighting_demand,
    heating_sys_electricity=simulateonetimestep.heating_sys_electricity,
    cooling_sys_electricity=simulateonetimestep.cooling_sys_electricity,
    energy_demand=simulateonetimestep.energy_demand,
    cop=simulateonetimestep.cop,
    run=test)  # -> out, test_passed; inputs run: Int32; plug-in component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
c_script_4 = CSharpScript(toggle=unit_test_slave.test_passed)  # -> out, A; inputs toggle: Boolean
# ---------- c_script_4: C# ----------
    Color ok = Color.Green;
    Color notOk = Color.Red;

    List<Grasshopper.Kernel.Special.GH_Group> groups = GrasshopperDocument
      .Objects
      .OfType<Grasshopper.Kernel.Special.GH_Group>()
      .Where(gr => gr.ObjectIDs.Contains(Component.InstanceGuid))
      .ToList<Grasshopper.Kernel.Special.GH_Group>();

    Color renderColor = ok;
    if (!toggle)
    {
      renderColor = notOk;
    }

    foreach (Grasshopper.Kernel.Special.GH_Group gr in groups)
    {
      gr.Colour = renderColor;
    }
# ---------- end c_script_4 ----------
panel_17 = Panel(unit_test_slave.out)

# ----
# y-axis ticks (in progress)
energy_2 = QuickGraph([simulatemultipletimesteps.solar_gains, python_2.internal_gains, lighting_demand_w, heating_demand_w, cooling_demand_w])
occupancy = QuickGraph(python_2.occupancy)
eval = Evaluate(F="(y-x)/z+1", x="0", y="30", z="5")
graph_gridlines = PythonScript(start="0", end="30", y_interval="5", x_length=number_of_hours)  # -> out, a; inputs x_length: Int32
# ---------- graph_gridlines: Python ----------
"""
This funtion creates a series of lists which can be used 

list_to_tree was taken from https://gist.github.com/piac/ef91ac83cb5ee92a1294
"""
domain = end - start

def list_to_tree(input, none_and_holes=True, source=[0]):
    """Transforms nestings of lists or tuples to a Grasshopper DataTree"""
    from Grasshopper import DataTree as Tree
    from Grasshopper.Kernel.Data import GH_Path as Path
    from System import Array
    def proc(input,tree,track):
        path = Path(Array[int](track))
        if len(input) == 0 and none_and_holes: tree.EnsurePath(path); return
        for i,item in enumerate(input):
            if hasattr(item, '__iter__'): #if list or tuple
                track.append(i); proc(item,tree,track); track.pop()
            else:
                if none_and_holes: tree.Insert(item,path,i)
                elif item is not None: tree.Add(item,path)
#if input is not None: t=Tree[object]();proc(input,t,source[:]);return t

# create a list of the desired ticks
y_ticks = []
number_of_ticks = int(domain//y_interval)
for ii in range(0,number_of_ticks):
    y_ticks.append(start+ii*y_interval)

# create a list of lists, with each sublist having length x_length
tick_list = []
for tick in y_ticks:
    tick_list.append([tick]*x_length)

a = list_to_tree(tick_list,True,[0])
# ---------- end graph_gridlines ----------
series_3 = Series(Start="0", Step="5", Count=eval)
dup = DuplicateData(Data=graft(series_3), Number=number_of_hours, Order=True)
panel_18 = Panel(graph_gridlines.out)

# ---- group: Temperature
graph = QuickGraph([outdoor_temperature, indoor_temperature, mass_temperature, dup])

# ----
number_slider_3 = Slider(19, range=-15..30)

panel_19 = Panel("C:\Users\Zghiru\Documents\GitHub\RC_BuildingSimulator\rc_simulator\grasshopper_component")  # disabled
toggle_4 = BooleanToggle(False)  # disabled
exportladybug_2 = Ladybug_ExportLadybug(components=emissionsystems, targetFolder=panel_19, export=toggle_4)  # -> readMe; disabled; plug-in component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
panel_20 = Panel(exportladybug_2)  # disabled

number_slider_4 = Slider(20, range=-15..30)
number_slider_5 = Slider(0.1, range=0..1)
number_slider_6 = Slider(95, range=0..2000)
number_slider_7 = Slider(2000, range=0..2000)

# ==== cluster Cluster
L = ClusterInput()
lng = ListLength(List=L)
G = ClusterInput()
series = Series(Start=0, Step=1, Count=lng)
area = Area(Geometry=G)  # -> Area, Centroid
int = Integer(series)
orient2camera = Ladybug_OrientToCamera(initPosition=area.Centroid)  # -> orientedToCam; plug-in component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
int_2 = ClusterOutput(int)
timer = Timer(TimerInterval=1000, Target=orient2camera)
orientedtocam = ClusterOutput(orient2camera)
